# Grasshopper definition BowyerWatsonAlgorithmUsingAnemone.gh (Grasshopper 1.0.7)
# plug-ins: MeshEdit Components, Anemone

pt = Point([Point(4.973371683, 1.107439772, 0), Point(19.95782102, 8.75821514, 0), Point(3.492954962, 9.938639905, 0), Point(14.67619918, 1.501338799, 0), Point(13.12880424, 9.375742073, 0), Point(8.44692768, 6.064084892, 0)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])
restart = Button()
cluster = Cluster(pt=pt)
loop_start = LoopStart(N=9999999, T=[pt, restart], D0=pt, D1=cluster)  # -> port, Counter, Data, Data_2
split = SplitList(List=loop_start.Data, Index=1)  # -> ListA, ListB
facec = FaceCircles(Mesh=loop_start.Data_2)  # -> Centers, Ratio
darc = DeconstructArc(Arc=facec.Centers)  # -> BasePlane, Radius, Angle
pt_2 = Point(split.ListA)
dist = Distance(PointA=pt_2, PointB=darc.BasePlane)
smaller = SmallerThan(FirstNumber=dist, SecondNumber=darc.Radius)  # -> SmallerThan, OrEqualTo
cullf = CullFaces(Mesh=loop_start.Data_2, Pattern=invert(smaller.SmallerThan))
cullf_2 = CullFaces(Mesh=loop_start.Data_2, Pattern=smaller.SmallerThan)
medges = MeshEdges(Mesh=cullf)  # -> NakedEdges, InteriorEdges, NonManifoldEdges
item = ListItem(List=split.ListB, Index=0, Wrap=True)
extr = ExtrudePoint(Base=medges.NakedEdges, Point=pt_2)
null = NullItem(Item=item)  # -> NullFlags, InvalidFlags, Description
smesh = SimpleMesh(Brep=extr)
mjoin = MeshJoin(Meshes=flatten([cullf_2, smesh]))
weldvertices = MeshWeldVertices(Mesh=mjoin, Tolerance=0.01)  # -> RuntimeMessage, Mesh
unim = UnifyMesh(Mesh=weldvertices.Mesh)  # -> Result, Count
loop_end = LoopEnd(
    port=loop_start.port,
    Exit=null.NullFlags,
    Data=split.ListB,
    Data_2=unim.Result,
    TimeOutVal=0,
    pausedState=False,
    state="Constant output")  # -> D0, D1
demesh = DeconstructMesh(Mesh=cluster)  # -> Vertices, Faces, Colours, Normals
demesh_2 = DeconstructMesh(Mesh=loop_end.D1)  # -> Vertices, Faces, Colours, Normals
cp = ClosestPoint(Point=demesh.Vertices, Cloud=demesh_2.Vertices)  # -> ClosestPoint, CPIndex, Distance
deletev = DeleteVertices(Mesh=loop_end.D1, Indices=cp.CPIndex, Shrink=True)

# ==== cluster Cluster
pt = ClusterInput()
pt_2 = Point(pt)
bbox = BoundingBox(Content=pt_2, Plane=PlaneXY(0, 0, 0), UnionBox=True)  # -> Box, Box_2
box = EvaluateBox(Box=bbox.Box, UParameter=0.5, VParameter=0.5, WParameter=0.5)  # -> Plane, Point, Include
panel = Panel("""0.0
0.5
1.0""")
scale = Scale(Geometry=bbox.Box, Center=box.Point, Factor=10)  # -> Geometry, Transform
crossref = CrossReference(ListA=panel, ListB=panel, CrossMode=1)  # -> ListA, ListB
box_2 = EvaluateBox(Box=scale.Geometry, UParameter=crossref.ListA, VParameter=crossref.ListB, WParameter=0.5)  # -> Plane, Point, Include
cull_i = CullIndex(List=box_2.Point, Indices=4, Wrap=True)
panel_2 = Panel("""T{0;1;3}
T{1;6;3}
T{1;2;4}
T{1;4;6}
T{3;6;5}
T{6;4;7}""")
conmesh = ConstructMesh(Vertices=cull_i, Faces=panel_2)
M = ClusterOutput(conmesh)
