# Grasshopper definition SuperDelaunayTest.gh (Grasshopper 1.0.7)
# plug-ins: Super Delaunay 2d, Weaverbird

genes = GenePool(Decimals=2, Maximum=20, Minimum=0, Value=[0, 0, 0, 1.68, 0, 0, 0, 0, 14.84, 13.27, 0])
genes_2 = GenePool(Decimals=2, Maximum=20, Minimum=0, Value=[0, 0, 8.56, 7.65, 0, 11.45, 0, 0, 7.9, 0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])
pop2d = Populate2D(Region={Plane=PlaneXY(17.5, 8, 0), Size=Domain2(u=-15.5..15.5, v=-6..6)}, Count=100, Seed=1)
number_slider = Slider(1.25, range=0..2)
number_slider_2 = Slider(0.3, range=0..1)

# ---- group: Create new delaunay | Create mode
# 3 modes of use from component menu (via right click)
delaunay = Delaunay(Points=pop2d, Weights=genes_2, DelaunayPreview_Weights=False)  # -> Delaunay, Edges, EdgesTopology

# ----
# Primal (Delaunay) and dual (Voronoi) thickener
P = Points([Point(8.467969504, 42, 0), Point(10.09328688, 45.40130329, 0), Point(13.60112146, 44.6871843, 0), Point(11.55399205, 43.20235725, 0), Point(14.19380754, 41.54331814, 0), Point(13.67664575, 37.74997509, 0), Point(11.52562246, 40.74129649, 0), Point(7.354242077, 38.49339284, 0), Point(6.429764127, 45, 0), Point(12.67652244, 47.86839967, 0), Point(17.12315077, 43, 0)])
number_slider_3 = Slider(1.26, range=0.01..20)
delaunay_2 = Delaunay(Points=P, Weights=genes, Radius=number_slider_2, DivisionFactor=number_slider, DelaunayOutputMode=4)  # -> Delaunay, ThickenerPrimal, ThickenerPrimalTopology
number_slider_4 = Slider(4.43, range=0.01..20)
move = Move(Geometry=delaunay_2.Delaunay, Motion=Vector(1, -18, 0))  # -> Geometry, Transform
Z = UnitZ(Factor=number_slider_2)
circle = Circle({Plane=Plane(origin=(12, 25, 0), x=(0.9363291776, -0.3511234416, 0), y=(0.3511234416, 0.9363291776, 0)), Radius=8.544003745})
pt = Point(Point(8.202990731, 4.908292837, 0))
pt_2 = Point(Point(27.5685717, 10.27098316, 0))
move_2 = Move(Geometry=P, Motion=Z)  # -> Geometry, Transform
delaunay_3 = Delaunay(
    PreexistingDelaunay=move.Geometry,
    Bounds=circle,
    Radius=number_slider_2,
    DivisionFactor=number_slider,
    DelaunayInputMode=2,
    DelaunayOutputMode=5)  # -> Delaunay, ThickenerDual, ThickenerDualTopology
merge = Merge(Data1=pt, Data2=pt_2)
merge_2 = Merge(Data1=number_slider_3, Data2=number_slider_4)
list = ValueList({"One": 1, "Two": 2, "Three": 2² - 1, "Zero": 0}, selected="One")
points = PointList(Points=move_2.Geometry, Size=1)

# ---- group: Insert weighted points | Dynamic mode
delaunay_4 = Delaunay(
    PreexistingDelaunay=delaunay.Delaunay,
    Points=merge,
    Weights=merge_2,
    DelaunayInputMode=1,
    DelaunayOutputMode=6,
    DelaunayPreview_Edges=False)  # -> Delaunay, ConvexHull, ConvexHullTopology

# ----
wbcatmullclark = WeaverbirdsCatmullClarkSubdivision(MeshCurves=delaunay_2.ThickenerPrimal, Level=list, SmoothNakedEdges=1)
wbcatmullclark_2 = WeaverbirdsCatmullClarkSubdivision(MeshCurves=delaunay_3.ThickenerDual, Level=list, SmoothNakedEdges=1)
merge_3 = Merge(Data1=flatten(pop2d), Data2=flatten(pt), Data3=flatten(pt_2))
merge_4 = Merge(Data1=flatten(genes_2), Data2=flatten(number_slider_3), Data3=flatten(number_slider_4))
lng = ListLength(List=merge_3)
preview = CustomPreview(
    Geometry=wbcatmullclark_2,
    Material={diffuse=RGB(255, 0, 132), emission=RGB(76, 0, 40), shine=0.5, specular=RGB(255, 255, 255), transparency=0})
preview_2 = CustomPreview(
    Geometry=wbcatmullclark,
    Material={diffuse=RGB(0, 242, 255), emission=RGB(0, 73, 76), shine=0.5, specular=RGB(255, 255, 255), transparency=0})
tag = TextTag3D(
    Location=[PlaneXY(11, 49, 0), PlaneXY(12, 35, 0)],
    Text=["Primal Thickness", "Dual Thickness"],
    Size=0.66,
    Colour=RGB(0, 0, 0),
    Justification=5)
R = Region({Plane=PlaneXY(59.05534856, -142.561085, 0), Size=Domain2(u=-58.63149277..58.63149277, v=-38.07126648..38.07126648)})

# ---- group: Extract only | Output mode
delaunay_5 = Delaunay(
    PreexistingDelaunay=delaunay_4.Delaunay,
    Bounds=delaunay_4.ConvexHull,
    DelaunayInputMode=2,
    DelaunayOutputMode=3,
    DelaunayPreview_Edges=True,
    DelaunayPreview_Orthoballs=False,
    DelaunayPreview_Weights=True)  # -> Delaunay, Voronoi, VoronoiTopology

# ----
larger = LargerThan(FirstNumber=merge_4, SecondNumber=0.001)  # -> LargerThan, OrEqualTo
series = Series(Start=0, Step=1, Count=lng)
drec = DeconstuctRectangle(Rectangle=R)  # -> BasePlane, XInterval, YInterval
medges = MeshEdges(Mesh=[wbcatmullclark, wbcatmullclark_2])  # -> NakedEdges, InteriorEdges, NonManifoldEdges
# The dynamic mode allows you to insert new points without recalculating everything
R_2 = Region({Plane=PlaneXY(51.87428095, -35.3146362, 0), Size=Domain2(u=-51.99664166..51.99664166, v=-26.77847682..26.77847682)})
dispatch = Dispatch(List=delaunay_5.Voronoi, DispatchPattern=larger.LargerThan)  # -> ListA, ListB
cull = CullPattern(List=merge_3, CullPattern=larger.LargerThan)
cull_2 = CullPattern(List=series, CullPattern=larger.LargerThan)
ellipse = Ellipse(Plane=drec.BasePlane, Radius1=expr("x/2", drec.XInterval), Radius2=expr("x/2", drec.YInterval))  # -> Ellipse, Focus1, Focus2
preview_3 = CustomPreview(
    Geometry=medges.InteriorEdges,
    Material={diffuse=RGB(0, 0, 0), emission=RGB(0, 0, 0), shine=0.5, specular=RGB(255, 255, 255), transparency=0})
pop2d_2 = Populate2D(Region=R_2, Count="5000", Seed=1)  # disabled
preview_4 = CustomPreview(
    Geometry=dispatch.ListA,
    Material={diffuse=RGB(255, 0, 132), emission=RGB(76, 0, 40), shine=0.5, specular=RGB(255, 255, 255), transparency=0})
tag_2 = TextTag3D(Location=cull, Text=cull_2, Size=0.66, Colour=RGB(0, 0, 0), Justification=5)
boundary = BoundarySurfaces(Edges=R)
preview_5 = CustomPreview(
    Geometry=dispatch.ListB,
    Material={diffuse=RGB(0, 242, 255), emission=RGB(0, 73, 76), shine=0.5, specular=RGB(255, 255, 255), transparency=0})
tag_3 = TextTag3D(Location=PlaneXY(18.91076001, 15.02132964, 0), Text="Weighted Voronoi", Size=0.66, Colour=RGB(0, 0, 0), Justification=5)
number_slider_5 = Slider(74.02, range=0..420)
delaunay_6 = Delaunay(Points=pop2d_2)  # -> Delaunay, Edges, EdgesTopology; disabled
popgeo = PopulateGeometry(Geometry=boundary, Count=Slider(400, range=0..10000), Seed=1)
number_slider_6 = Slider(3.52, range=0..10)  # disabled
cluster = Cluster_2(crv=ellipse.Ellipse, B=Slider(2.5, range=0..10), C=Slider(0.529, range=0..1))
pt_3 = Point(Point(35.85731209, -25.30887013, 0))  # disabled
pull = PullPoint(Point=popgeo, Geometry=cluster, ClosestOnly=True)  # -> ClosestPoint, Distance
delaunay_7 = Delaunay(PreexistingDelaunay=delaunay_6.Delaunay, Points=pt_3, Weights=number_slider_6, DelaunayInputMode=1)  # -> Delaunay, Edges, EdgesTopology; disabled
expression = Expression(d=pull.Distance, w=Slider(4.78, range=0..30), a=number_slider_5, Expression="a*exp(-d²/w²)")
R_3 = Region({Plane=PlaneXY(45, 5, 0), Size=Domain2(u=-5..5, v=-5..5)})
multiplication = Multiplication(A=number_slider_5, B=Slider(0.2, range=0..1))
md_slider = MDSlider(SliderMode=0, slider_value=Point(0, 0, 0.5), x_domain=Domain(0, 1), y_domain=Domain(0, 1), z_domain=Domain(0, 1))
# Some graphs that can be extracted from delaunay
pop2d_3 = Populate2D(Region=R_3, Count=500, Seed=1)
delaunay_8 = Delaunay(Points=popgeo, Weights=expression, Bounds=R, DelaunayOutputMode=3, DelaunayPreview_Edges=False)  # -> Delaunay, Voronoi, VoronoiTopology
larger_2 = LargerThan(FirstNumber=expression, SecondNumber=multiplication)  # -> LargerThan, OrEqualTo
cluster_2 = Cluster(pt=pop2d_3, P=md_slider, B=Slider(1.502, range=0..2), T=Slider(1.55, range=0..10))
pcol = PolylineCollapse(Polyline=delaunay_8.Voronoi, Tolerance=0.1)  # -> Polyline, Count
series_2 = Series(Start=11, Step=11, Count=5)
# The output mode allows to extract some info without recalculating the triangulation
pt_4 = Point([Point(28.98233151, 25.41706196, 0), Point(36.68582708, 26.84611755, 0), Point(34.05408965, 20.94488605, 0), Point(28.42511378, 20.57825849, 0), Point(33.652026, 29.3630823, 0), Point(29.2130776, 29.41697546, 0)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])
cull_3 = CullPattern(List=pcol.Polyline, CullPattern=invert(larger_2.LargerThan))
delaunay_9 = Delaunay(Points=pop2d_3, Weights=cluster_2, DelaunayOutputMode=1, DelaunayPreview_Weights=True)  # -> Delaunay, Edges, EdgesTopology
X = UnitX(Factor=series_2)
Z_2 = UnitZ(Factor=-0.01)
pt_5 = Point(Point(44.97685561, 11.26935808, 0))
disc = Discontinuity(Curve=cull_3, Level=1)  # -> Points, Parameters
cull_4 = CullPattern(List=pcol.Polyline, CullPattern=larger_2.LargerThan)
addition = Addition(A=X, B=Z_2)
preview_6 = CustomPreview(
    Geometry=delaunay_9.Edges,
    Material={diffuse=RGB(186, 186, 186), emission=RGB(56, 56, 56), shine=0.5, specular=RGB(255, 255, 255), transparency=0})
move_3 = Move(Geometry=pt_5, Motion=graft(addition))  # -> flatten(Geometry), Transform
delaunay_10 = Delaunay(Points=pt_4)  # -> Delaunay, Edges, EdgesTopology
bbox = BoundingBox(Content=pt_4, Plane=PlaneXY(0, 0, 0), UnionBox=True)  # -> Box, Box_2
nurbs = NurbsCurve(Vertices=disc.Points, Degree=3, Periodic=True)  # -> flatten(Curve), Length, Domain
move_4 = Move(Geometry=delaunay_9.Delaunay, Motion=graft(X))  # -> Geometry, Transform
move_5 = Move(Geometry=delaunay_9.Edges, Motion=graft(addition))  # -> Geometry, Transform
merge_5 = Merge(Data1=pt_5, Data2=move_3.Geometry)
move_6 = Move(Geometry=delaunay_10.Edges, Motion=Vector(0, 0, -0.01))  # -> Geometry, Transform
rec = Rectangle(bbox.Box)
panel = Panel("""Delaunay
Minimum Spanning Tree
Relative Neighborhood
Urquhart
Beta Skeleton
Nearest Neighbor""")
tag_4 = TextTag3D(
    Location=PlaneXY(64, 31, 0),
    Text="Topology extraction + Convex Hull + Alpha Shape",
    Size=0.66,
    Colour=RGB(0, 0, 0),
    Justification=5)
bang = ExplodeTree(Data=move_4.Geometry)  # -> Branch0, Branch1, Branch2, Branch3, Branch4
preview_7 = CustomPreview(
    Geometry=move_6.Geometry,
    Material={diffuse=RGB(186, 186, 186), emission=RGB(56, 56, 56), shine=0.5, specular=RGB(255, 255, 255), transparency=0})
tag_5 = TextTag3D(Location=merge_5, Text=panel, Size=0.66, Colour=RGB(0, 0, 0), Justification=5)
preview_8 = CustomPreview(
    Geometry=move_5.Geometry,
    Material={diffuse=RGB(186, 186, 186), emission=RGB(56, 56, 56), shine=0.5, specular=RGB(255, 255, 255), transparency=0})

# ---- group: Voronoi
number_slider_7 = Slider(474, range=0..1000)
delaunay_11 = Delaunay(PreexistingDelaunay=delaunay_10.Delaunay, Bounds=rec, DelaunayInputMode=2, DelaunayOutputMode=3)  # -> Delaunay, Voronoi, VoronoiTopology
branch = TreeBranch(Tree=simplify(delaunay_11.VoronoiTopology), Path=number_slider_7, MaintainPaths=True)
item = ListItem(List=delaunay_11.Voronoi, Index=number_slider_7, Wrap=True)
item_2 = ListItem(List=delaunay_11.Voronoi, Index=branch, Wrap=True)
boundary_2 = BoundarySurfaces(Edges=item)
preview_9 = CustomPreview(
    Geometry=boundary_2,
    Material={diffuse=RGB(255, 0, 132), emission=RGB(76, 0, 40), shine=0.5, specular=RGB(255, 255, 255), transparency=0})
preview_10 = CustomPreview(
    Geometry=item_2,
    Material={diffuse=RGB(0, 242, 255), emission=RGB(0, 73, 76), shine=0.5, specular=RGB(255, 255, 255), transparency=0})

# ---- group: Edges
number_slider_8 = Slider(16, range=0..1000)
delaunay_12 = Delaunay(PreexistingDelaunay=delaunay_10.Delaunay, DelaunayInputMode=2, DelaunayOutputMode=1)  # -> Delaunay, Edges, EdgesTopology
branch_2 = TreeBranch(Tree=simplify(delaunay_12.EdgesTopology), Path=number_slider_8, MaintainPaths=True)
item_3 = ListItem(List=delaunay_12.Edges, Index=number_slider_8, Wrap=True)
item_4 = ListItem(List=pt_4, Index=branch_2, Wrap=True)
preview_11 = CustomPreview(
    Geometry=item_3,
    Material={diffuse=RGB(255, 0, 132), emission=RGB(76, 0, 40), shine=0.5, specular=RGB(255, 255, 255), transparency=0})
preview_12 = CustomPreview(
    Geometry=item_4,
    Material={diffuse=RGB(0, 242, 255), emission=RGB(0, 73, 76), shine=0.5, specular=RGB(255, 255, 255), transparency=0})

# ---- group: Vertices
number_slider_9 = Slider(191, range=0..1000)
delaunay_13 = Delaunay(PreexistingDelaunay=delaunay_10.Delaunay, DelaunayInputMode=2, DelaunayOutputMode=0)  # -> Delaunay, Vertices, VerticesTopology, Connected
branch_3 = TreeBranch(Tree=simplify(delaunay_13.VerticesTopology), Path=number_slider_9, MaintainPaths=True)
item_5 = ListItem(List=delaunay_13.Vertices, Index=number_slider_9, Wrap=True)
item_6 = ListItem(List=pt_4, Index=branch_3, Wrap=True)
preview_13 = CustomPreview(
    Geometry=item_5,
    Material={diffuse=RGB(255, 0, 132), emission=RGB(76, 0, 40), shine=0.5, specular=RGB(255, 255, 255), transparency=0})
preview_14 = CustomPreview(
    Geometry=item_6,
    Material={diffuse=RGB(0, 242, 255), emission=RGB(0, 73, 76), shine=0.5, specular=RGB(255, 255, 255), transparency=0})

# ---- group: Faces
number_slider_10 = Slider(612, range=0..1000)
delaunay_14 = Delaunay(PreexistingDelaunay=delaunay_10.Delaunay, DelaunayInputMode=2, DelaunayOutputMode=2)  # -> Delaunay, Mesh, MeshTopology
branch_4 = TreeBranch(Tree=simplify(delaunay_14.MeshTopology), Path=number_slider_10, MaintainPaths=True)
faceb = FaceBoundaries(Mesh=delaunay_14.Mesh)
item_7 = ListItem(List=pt_4, Index=branch_4, Wrap=True)
item_8 = ListItem(List=faceb, Index=number_slider_10, Wrap=True)
preview_15 = CustomPreview(
    Geometry=item_8,
    Material={diffuse=RGB(255, 0, 132), emission=RGB(76, 0, 40), shine=0.5, specular=RGB(255, 255, 255), transparency=0})
preview_16 = CustomPreview(
    Geometry=item_7,
    Material={diffuse=RGB(0, 242, 255), emission=RGB(0, 73, 76), shine=0.5, specular=RGB(255, 255, 255), transparency=0})

# ---- group: Beta Skeleton
delaunay_15 = Delaunay(PreexistingDelaunay=bang.Branch3, Beta=Slider(1, range=0..2), DelaunayInputMode=2, DelaunayOutputMode=8)  # -> Delaunay, BetaSkeleton, BetaSkeletonTopology
pipe = Pipe(Curve=delaunay_15.BetaSkeleton, Radius=0.05, Caps=0)
preview_17 = CustomPreview(
    Geometry=pipe,
    Material={diffuse=RGB(255, 0, 132), emission=RGB(76, 0, 40), shine=0.5, specular=RGB(255, 255, 255), transparency=0})

# ---- group: Alpha Shape
delaunay_16 = Delaunay(PreexistingDelaunay=delaunay_10.Delaunay, Alpha=Slider(0.67, range=0..2), DelaunayInputMode=2, DelaunayOutputMode=7)  # -> Delaunay, AlphaShape, AlphaShapeTopology
preview_18 = CustomPreview(
    Geometry=delaunay_16.AlphaShape,
    Material={diffuse=RGB(255, 0, 132), emission=RGB(76, 0, 40), shine=0.5, specular=RGB(255, 255, 255), transparency=0})

# ---- group: Convex Hull
delaunay_17 = Delaunay(PreexistingDelaunay=delaunay_10.Delaunay, DelaunayInputMode=2, DelaunayOutputMode=6)  # -> Delaunay, ConvexHull, ConvexHullTopology
preview_19 = CustomPreview(
    Geometry=delaunay_17.ConvexHull,
    Material={diffuse=RGB(0, 242, 255), emission=RGB(0, 73, 76), shine=0.5, specular=RGB(255, 255, 255), transparency=0})

# ---- group: Minimum Spanning Tree
delaunay_18 = Delaunay(PreexistingDelaunay=bang.Branch0, DelaunayInputMode=2, DelaunayOutputMode=12)  # -> Delaunay, MinimumSpanningTree, MinimumSpanningTreeTopology
pipe_2 = Pipe(Curve=delaunay_18.MinimumSpanningTree, Radius=0.05, Caps=0)
preview_20 = CustomPreview(
    Geometry=pipe_2,
    Material={diffuse=RGB(255, 0, 132), emission=RGB(76, 0, 40), shine=0.5, specular=RGB(255, 255, 255), transparency=0})

# ---- group: Relative Neighborhood Graph
delaunay_19 = Delaunay(PreexistingDelaunay=bang.Branch1, DelaunayInputMode=2, DelaunayOutputMode=9)  # -> Delaunay, RelativeNeighborhoodGraph, RelativeNeighborhoodGraphTopology
pipe_3 = Pipe(Curve=delaunay_19.RelativeNeighborhoodGraph, Radius=0.05, Caps=0)
preview_21 = CustomPreview(
    Geometry=pipe_3,
    Material={diffuse=RGB(255, 0, 132), emission=RGB(76, 0, 40), shine=0.5, specular=RGB(255, 255, 255), transparency=0})

# ---- group: Urquart Graph
delaunay_20 = Delaunay(PreexistingDelaunay=bang.Branch2, DelaunayInputMode=2, DelaunayOutputMode=11)  # -> Delaunay, UrquhartGraph, UrquhartGraphTopology
pipe_4 = Pipe(Curve=delaunay_20.UrquhartGraph, Radius=0.05, Caps=0)
preview_22 = CustomPreview(
    Geometry=pipe_4,
    Material={diffuse=RGB(255, 0, 132), emission=RGB(76, 0, 40), shine=0.5, specular=RGB(255, 255, 255), transparency=0})

# ---- group: Nearest Neighbor Graph
delaunay_21 = Delaunay(PreexistingDelaunay=bang.Branch4, DelaunayInputMode=2, DelaunayOutputMode=10)  # -> Delaunay, NearestNeighborGraph, NearestNeighborGraphTopology
pipe_5 = Pipe(Curve=delaunay_21.NearestNeighborGraph, Radius=0.05, Caps=0)
preview_23 = CustomPreview(
    Geometry=pipe_5,
    Material={diffuse=RGB(255, 0, 132), emission=RGB(76, 0, 40), shine=0.5, specular=RGB(255, 255, 255), transparency=0})

# ---- group: Weighted points
pt_6 = Point(Point(129.7809549, 4.844930613, 0))
pt_7 = Point(Point(123.7809549, 11.84493061, 0))
pt_8 = Point(Point(122.7809549, 2.844930613, 0))
sqrt = SquareRoot(Value=Slider(5.71, range=0..10))
sqrt_2 = SquareRoot(Value=Slider(6.31, range=0..10))
sqrt_3 = SquareRoot(Value=Slider(1.58, range=0..10))
pline = PolyLine(Vertices=[pt_8, pt_6, pt_7], Closed=True)
cir = Circle(Plane=[pt_8, pt_6, pt_7], Radius=[sqrt, sqrt_2, sqrt_3])
boundary_3 = BoundarySurfaces(Edges=pline)
preview_24 = CustomPreview(
    Geometry=boundary_3,
    Material={diffuse=RGB(195, 255, 0), emission=RGB(58, 76, 0), shine=0.5, specular=RGB(255, 255, 255), transparency=0})
preview_25 = CustomPreview(
    Geometry=cir,
    Material={diffuse=RGB(255, 170, 0), emission=RGB(76, 51, 0), shine=0.5, specular=RGB(255, 255, 255), transparency=0})

# ----
number_slider_11 = Slider(22, range=0..30)  # disabled
number_slider_12 = Slider(50, range=0..60)  # disabled
number_slider_13 = Slider(3, range=1..10)  # disabled
number_slider_14 = Slider(8, range=1..10)  # disabled

# ---- group: Weighted point to evaluate
weight = Slider(1.7, range=0..10)
pt_9 = Point(Point(120.4058305, 7.844930613, 0))
cir_2 = Circle(Plane=pt_9, Radius=weight)
preview_26 = CustomPreview(
    Geometry=cir_2,
    Material={diffuse=RGB(0, 111, 255), emission=RGB(0, 33, 76), shine=0.5, specular=RGB(255, 255, 255), transparency=0})

# ----
revsrf = Revolution(
    Curve=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,
    Axis=Line((126.4821359, 33.49483617, 0), (126.4821359, 33.49483617, 1)),
    Domain=Domain(0, 6.283185307))  # disabled
panel_2 = Panel("4000")  # disabled
popgeo_2 = PopulateGeometry(Geometry=revsrf, Count=panel_2, Seed=1)  # disabled
sinpattsrf = SinePatternOnSurface(srf=revsrf, int_2=number_slider_13, int=number_slider_14)  # disabled

# ---- group: Orthocircle
orthosphere = CSharpScript(pa=pt_8, pb=pt_6, pc=pt_7, wa=sqrt, wb=sqrt_2, wc=sqrt_3)  # -> out, A, B; inputs pa: Point3d, pb: Point3d, pc: Point3d, wa: Double, wb: Double, wc: Double
# ---------- orthosphere: C# ----------
    var vab = pb - pa;
    var dab = vab.Length;
    vab.Unitize();
    var vac = pc - pa;
    var dac = vac.Length;
    vac.Unitize();
    var normal = Vector3d.CrossProduct(vab, vac);
    var perpab = Vector3d.CrossProduct(vab, normal);
    var wa2 = wa * wa;
    var xab = (dab + (wa2 - wb * wb) / dab) / 2.0;
    var lab = new Line(pa + vab * xab, perpab, 1);
    var perpac = Vector3d.CrossProduct(vac, normal);
    var xac = (dac + (wa2 - wc * wc) / dac) / 2.0;
    var lac = new Line(pa + vac * xac, perpac, 1);
    double ta;
    double tb;
    Rhino.Geometry.Intersect.Intersection.LineLine(lab, lac, out  ta, out tb);
    var center = lab.PointAt(ta);
    
    A = center;
    B = Math.Sqrt(Math.Max(0, center.DistanceToSquared(pa) - wa2));
# ---------- end orthosphere ----------
cir_3 = Circle(Plane=orthosphere.A, Radius=orthosphere.B)
preview_27 = CustomPreview(
    Geometry=cir_3,
    Material={diffuse=RGB(255, 0, 0), emission=RGB(76, 0, 0), shine=0.5, specular=RGB(255, 255, 255), transparency=0})

# ----
pull_2 = PullPoint(Point=popgeo_2, Geometry=sinpattsrf, ClosestOnly=True)  # -> ClosestPoint, Distance; disabled

# ---- group: Power distance
pta = Point(orthosphere.A)
wa = Number(orthosphere.B)
ptb = Point(pt_9)
wb = Number(weight)
dist = Distance(PointA=pta, PointB=ptb)
sqr = Square(Value=dist)
sqr_2 = Square(Value=wa)
sqr_3 = Square(Value=wb)
subtraction = Subtraction(A=sqr, B=sqr_2, C=sqr_3)
eval = Evaluate(F="x - x % 0.01", x=subtraction)

# ----
crv = Curve(revsrf)  # disabled
expression_2 = Expression(d=pull_2.Distance, w=number_slider_11, a=number_slider_12, Expression="a - a*exp(-6*d²/w²)")  # disabled
pull_3 = PullPoint(Point=popgeo_2, Geometry=crv, ClosestOnly=True)  # -> ClosestPoint, Distance; disabled
larger_3 = LargerThan(FirstNumber=pull_3.Distance, SecondNumber=1)  # -> LargerThan, OrEqualTo; disabled
multiplication_2 = Multiplication(A=expression_2, B=larger_3.LargerThan)  # disabled
bnd = Bounds(Numbers=multiplication_2)  # disabled
delaunay_22 = Delaunay(Points=popgeo_2, Weights=multiplication_2, DelaunayMetric=0, DelaunayOutputMode=6, DelaunayPreview_Edges=False)  # -> Delaunay, ConvexHull, ConvexHullTopology; disabled

# ---- group: Weighted Delaunay Criteria
ccx = CurveCurve(CurveA=cir_3, CurveB=cir_2)  # -> Points, ParamsA, ParamsB
panel_3 = Panel("If(x > 0, \"Outside\", If(x < 0, \"Inside\", \"Orthogonal\"))")
eval_2 = Evaluate(F=panel_3, x=eval)
item_9 = ListItem(List=ccx.ParamsB, Index=0, Wrap=True)
item_10 = ListItem(List=ccx.ParamsA, Index=0, Wrap=True)
panel_4 = Panel(eval_2)
eval_3 = EvaluateCurve(Curve=cir_2, Parameter=item_9)  # -> Point, Tangent, Angle
eval_4 = EvaluateCurve(Curve=cir_3, Parameter=item_10)  # -> Point, expr("-x", Tangent), Angle
addition_2 = Addition(A=eval_3.Point, B=eval_3.Tangent)
addition_3 = Addition(A=eval_4.Point, B=eval_4.Tangent)
tag_6 = TextTag3D(Location=pt_9, Text=panel_4, Size=0.6, Justification=2)
angledim = AngularDimension(Center=eval_4.Point, PointA=addition_3, PointB=addition_2, Reflex=False, Text="{0:0.0}°", Size=1)

# ----
remap = RemapNumbers(Value=multiplication_2, Source=bnd, Target=Domain(0, 1))  # -> Mapped, Clipped; disabled
delaunay_23 = Delaunay(PreexistingDelaunay=delaunay_22.Delaunay, Bounds=delaunay_22.ConvexHull, DelaunayInputMode=2, DelaunayOutputMode=3)  # -> Delaunay, Voronoi, VoronoiTopology; disabled
gradient = Gradient(
    LowerLimit=0,
    UpperLimit=1,
    Parameter=remap.Mapped,
    stops=[0.196: RGB(0, 117, 35), 0.301: RGB(0, 102, 255), 1: RGB(77, 0, 140)])  # disabled
preview_28 = CustomPreview(Geometry=delaunay_23.Voronoi, Material=gradient)  # disabled
number_slider_15 = Slider(5, range=3..10)  # disabled
number_slider_16 = Slider(2.5, range=0..10)  # disabled
number_slider_17 = Slider(5, range=0..10)  # disabled
panel_5 = Panel("500")  # disabled
R_4 = Region({Plane=PlaneXY(178.344293, 33.20382219, 0), Size=Domain2(u=-9.439984278..9.439984278, v=-9.439984278..9.439984278)})  # disabled
genes_3 = GenePool(Decimals=2, Maximum=6.28, Minimum=0, Value=[0, 0.8, 2.79])  # disabled
pt_10 = Point([Point(171.1859947, 3.905596478, 0), Point(183.7376165, 7.764058014, 0), Point(175.0909437, 15.4344936, 0)])  # disabled
multiplication_3 = Multiplication(A=number_slider_15, B=2)  # disabled
pop2d_4 = Populate2D(Region=R_4, Count=panel_5, Seed=1)  # disabled
line = Line([Line((172.5568681, 20.93766105, 0), (192.101162, 35.31431111, 0)), Line((189.0535771, 23.02459413, 0), (169.6228135, 48.12346463, 0)), Line((177.6876797, 37.64987463, 0), (166.0604811, 29.63340156, 0))])  # disabled
prot = RotatePlane(Plane=pt_10, Angle=genes_3)  # disabled
pull_4 = PullPoint(Point=pop2d_4, Geometry=line, ClosestOnly=True)  # -> ClosestPoint, Distance; disabled
series_3 = Series(Start=0, Step=expr("2*pi/x", multiplication_3), Count=multiplication_3)  # disabled
repeat = RepeatData(Data=[number_slider_16, number_slider_17], Length=multiplication_3)  # disabled
number_slider_18 = Slider(35.9, range=0..60)  # disabled
sqr_4 = Square(Value=pull_4.Distance)  # disabled
pt_11 = PointCylindrical(BasePlane=graft(prot), Angle=series_3, Radius=repeat, Elevation=0)  # disabled
bnd_2 = Bounds(Numbers=sqr_4)  # disabled
pline_2 = PolyLine(Vertices=pt_11, Closed=True)  # -> flatten(Polyline); disabled
remap_2 = RemapNumbers(Value=sqr_4, Source=bnd_2, Target=number_slider_18)  # -> Mapped, Clipped; disabled
number_slider_19 = Slider(1, range=0..4)  # disabled
delaunay_24 = Delaunay(
    Points=pop2d_4,
    Weights=remap_2.Mapped,
    Alpha=10,
    DelaunayOutputMode=7,
    DelaunayPreview_Edges=False,
    DelaunayPreview_InfiniteTriangles=False)  # -> Delaunay, AlphaShape, AlphaShapeTopology; disabled
boundary_4 = BoundarySurfaces(Edges=pline_2)  # disabled
panel_6 = Panel("1000")  # disabled
number_slider_20 = Slider(0.15, range=0.01..1.4)  # disabled
popgeo_3 = PopulateGeometry(Geometry=boundary_4, Count=panel_6, Seed=1)  # disabled
number_slider_21 = Slider(3, range=0..10)  # disabled
number_slider_22 = Slider(2, range=0..10)  # disabled
delaunay_25 = Delaunay(
    PreexistingDelaunay=delaunay_24.Delaunay,
    Radius=number_slider_20,
    DivisionFactor=number_slider_19,
    DelaunayInputMode=2,
    DelaunayOutputMode=4,
    DelaunayPreview_Edges=False)  # -> Delaunay, ThickenerPrimal, ThickenerPrimalTopology; disabled
pull_5 = PullPoint(Point=popgeo_3, Geometry=pline_2, ClosestOnly=True)  # -> ClosestPoint, Distance; disabled
pow = Power(A=pull_5.Distance, B=number_slider_22)  # disabled
bnd_3 = Bounds(Numbers=pow)  # disabled
remap_3 = RemapNumbers(Value=pow, Source=bnd_3, Target=number_slider_21)  # -> Mapped, Clipped; disabled
panel_7 = Panel("1.0")  # disabled
delaunay_26 = Delaunay(Points=popgeo_3, Weights=remap_3.Mapped, Alpha=panel_7, DelaunayOutputMode=7)  # -> Delaunay, AlphaShape, AlphaShapeTopology; disabled
delaunay_27 = Delaunay(PreexistingDelaunay=delaunay_26.Delaunay, Bounds=delaunay_26.AlphaShape, DelaunayInputMode=2, DelaunayOutputMode=3)  # -> Delaunay, Voronoi, VoronoiTopology; disabled

# ==== cluster Cluster
B = ClusterInput()
T = ClusterInput()
P = ClusterInput()
pt = ClusterInput()
pt_2 = Point(pt)
pdecon = Deconstruct(Point=P)  # -> XComponent, YComponent, ZComponent
bbox = BoundingBox(Content=pt_2, Plane=PlaneXY(0, 0, 0), UnionBox=True)  # -> Box, Box_2
box = EvaluateBox(Box=bbox.Box, UParameter=pdecon.XComponent, VParameter=pdecon.YComponent, WParameter=0.5)  # -> Plane, Point, Include
dist = Distance(PointA=pt_2, PointB=box.Point)
multiplication = Multiplication(A=dist, B=B)
sin = Sine(Value=multiplication)
remap = RemapNumbers(Value=sin, Source=Domain(-1, 1), Target=T)  # -> Mapped, Clipped
R = ClusterOutput(remap.Mapped)

# ==== cluster SinePatternOnSurface
srf = ClusterInput()
int = ClusterInput()
int_2 = ClusterInput()
srf_2 = Surface(srf)
int_3 = Integer(int)
int_4 = Integer(int_2)
multiplication = Multiplication(A="30", B=int_4)
multiplication_2 = Multiplication(A=int_3, B=2)
multiplication_3 = Multiplication(A=int_4, B=2)
range = Range(Domain=Domain(0, 1), Steps=expr("x-1", multiplication))
pi = Pi(Factor=range)
series = Series(Start=0, Step=expr("x/2", "30"), Count=multiplication_2)
multiplication_4 = Multiplication(A=pi, B=multiplication_3)
shift = ShiftList(List=multiplication_4, Shift=graft(series), Wrap=True)
cos = Cosine(Value=shift)
one_over_x = OneOverX(Value=multiplication_2)
series_2 = Series(Start=0, Step=one_over_x, Count=multiplication_2)
remap = RemapNumbers(Value=cos, Source=Domain(-1, 1), Target=one_over_x)  # -> Mapped, Clipped
addition = Addition(A=remap.Mapped, B=graft(series_2))
pt = ConstructPoint(XCoordinate=addition, YCoordinate=range, ZCoordinate=0)
evalsrf = EvaluateSurface(Surface=reparameterize(srf_2), Point=pt)  # -> Point, Normal, UDirection, VDirection, Frame
intcrv = Interpolate(Vertices=evalsrf.Point, Degree=3, Periodic=False, KnotStyle=1)  # -> simplify(Curve), Length, Domain
path_mapper = PathMapper(
    intcrv.Curve,
    source=["{A}", "{A;B}", "{A;B;C}", "{A;B;C;D}", "{A;B;C;D;E}", "{A;B;C;D;E;F}"],
    target=["{0}", "{A}", "{A;B}", "{A;B;C}", "{A;B;C;D}", "{A;B;C;D;E}"])
crv = Curve(path_mapper)
crv_2 = ClusterOutput(crv)

# ==== cluster Cluster_2
crv = ClusterInput()
crv_2 = Curve(crv)
box = EvaluateBox(Box=crv_2, UParameter=[0.001, 0.999], VParameter=0.5, WParameter=0.5)  # -> Plane, Point, Include
pline = PolyLine(Vertices=box.Point, Closed=False)
divide = DivideCurve(Curve=reparameterize(pline), Count=pline, Kinks=False)  # -> Points, Tangents, Parameters
C = ClusterInput()
B = ClusterInput()
project = ProjectPoint(Point=divide.Points, Direction=Vector(0, 42.69561389, 0), Geometry=crv_2)  # -> Point, Index
pi = Pi(Factor=divide.Parameters)
dist = Distance(PointA=divide.Points, PointB=project.Point)
multiplication = Multiplication(A=pi, B=B)
sin = Sine(Value=multiplication)
multiplication_2 = Multiplication(A=dist, B=sin, C=C)
Y = UnitY(Factor=multiplication_2)
move = Move(Geometry=divide.Points, Motion=Y)  # -> Geometry, Transform
intcrv = Interpolate(Vertices=move.Geometry, Degree=3, Periodic=False, KnotStyle=1)  # -> Curve, Length, Domain
C_2 = ClusterOutput(intcrv.Curve)
